vi "802.11 Host.gvi"   [LabVIEW Communications System Design Suite 2.0.1]
outputs:
  "Has been transferred?": bool
  "Is header?": bool
  "chain table": u64[8]
  "chain order": u8[8]
  "PiggyBack Address": u8[6]
  "Head Mac Address": u8[6]
  "Check the ID": u8
  "Check if it is matching?": bool
  "chain table_2": u64[8]
  "Order in Chain": u8
  "Piggy": u64
  "Index of Max ID": i32
panel controls:
  "Trigger TX": bool
  "Clear events": bool
  "Operation Mode": T2 = "RF Multi Station"
  "Primary Subband": UFXP(2.0) = 1
  "Transmit IP Address": string = "10.230.208.238"
  "Transmit Port": u16 = 12345
  "Receive Port": u16 = 12345
  "Tab": i32 = 3
  "Power Level [dBm]": f64
  "TX Frequency [Hz]": f64 = 2500000000
  "Destination MAC Address": u8[6] = [71, 111, 75, 117, 109, 95]
  "Device MAC Address": u8[6] = [71, 111, 75, 117, 109, 98]
  "TX Port (USRP only)": enum{"TX1/RF 0", "TX1/RF 1"} = "TX1/RF 0"
  "RX Port (USRP only)": T3 = "RX2/RF 1"
  "AGC": bool
  "Manual RX gain [dB]": f64 = 37.5
  "PN Data Packet Size": i32 = 1000
  "Subcarrier Format": i32 = "20 MHz (IEEE 802.11 a)"(0)
  "Stop": bool
  "RIO Device": string = "RIO0"
  "Station": bool = TRUE
  "reset TX staistics": bool
  "reset RX staistics": bool
  "PN Packets per Second": u32 = 5000
  "Transmit ACK": bool = TRUE
  "All": bool
  "None": bool
  "Events to Track": T5
  "CCA Energy Detection Threshold [dBm]": FXP(10.3) = -72
  "MCS": UFXP(4.0) = 4
  "session": "802.11 Host Session.gtype" = {"PN packet"=[28, 159, 56, 150, 78, 47, 146, 174, 156, 39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], "USRP session"={"Data Clock Rate"=120000000, "Radio Settings Bus Semaphore"=-1924136955, "DB Queues"=[refnum, refnum], "Characterization Data Valid?"=TRUE, "EEPROM Header"={"Checksum"=0, "Product Code"=30509, "Hardware Current Version"=6, "Hardware Oldest Compatible Version"=4, "EEPROM Map Current Version"=2, "EEPROM Map Oldest Compatible Version"=2, "User Password"="", "Pointer to Factory Header"=64, "Pointer to User Header"=4294967295, "Recommended Interval"=24, "Number of Reserved Bytes"=9, "Number of Daughterboards"=2, "Daughterboard IDs"=[103, 103], "Daughterboard Serial Numbers"=["3095095\u0000\u0000", "3095076\u0000\u0000"]}, "Device Data Header"={"Checksum"=0, "Number of Channels"=4, "Number of Gain Settings"=[1, 1, 1, 1], "Pointer to Characterization Data"=[192, 11720, 17512, 29040], "Number of Reserved Bytes"=27, "Number of Frequencies"=[480, 241, 480, 241]}, "EEPROM Characterization Header"={"Checksum"=0, "Date"=2015-06-18T01:02:52Z, "Temperature"=25, "Misc. Info"="", "Pointer to Device Data Header"=128, "Number of Reserved Bytes"=28}, "Characterization Data"=[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], "FPGA Current Version"=3, "FPGA Oldest Compatible Version"=3, "Fixed Logic Current Version"=4, "Fixed Logic Oldest Compatible Version"=1, "FPGA Radio Settings Bus Current Version"=2, "FPGA Radio Settings Bus Oldest Compatible Version"=2, "FPGA Board Config Current Version"=2, "FPGA Board Config Oldest Compatible Version"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
  "Data Source Option": i32 = 1
  "Data Sink Options": i32
  "Data Source": enum{"UDP", "PN Data", "Manual"} = "PN Data"
  "Data Sink": enum{"Off", "UDP"} = "Off"
  "Reference Clock": string = "Internal"
  "USRP bandwidth": "USRP bandwidth.gtype" = "40 MHz"
  "WiMAC FPGA Ref": any
  "CW Max": u16 = 16
  "CW Min": u16 = 16
  "Fixed backoff value": u16 = 60000
  "Fixed backoff?": bool = TRUE
  "Exponential Backoff Ratio": UFXP(6.10) = 2
  "time to wait for decoding packet": u32 = 700
  "Backoff: CW Max": T13 = "CW Max"
  "Backoff: CW Min": T13 = "CW Min"
  "Backoff: Exponential Backoff Ratio": enum{"Default", "Exponential Backoff Ratio"} = "Exponential Backoff Ratio"
  "Backoff: Fixed Backoff Value": T13 = "Fixed Backoff Value"
  "Backoff: Fixed Backoff?": T14 = "Fixed Backoff?"
  "Piggyback: Enable Piggyback": T14 = "Enable Piggyback?"
  "Piggyback: Piggyback Address": enum{"Default", "Piggyback MAC Address"} = "Piggyback MAC Address"
  "Enable Piggyback": bool = TRUE
  "Use RTR instead of Data?": bool
  "Set Backoff Done Pulse to False": bool
  "Flow ID": u8
  "Address 1": u8[6] = [71, 111, 75, 117, 109, 98]
  "Address 2": u8[6] = [71, 111, 75, 117, 109, 99]
  "Address 3": u8[6] = [71, 111, 75, 117, 109, 100]
  "Address 4": u8[6] = [71, 111, 75, 117, 109, 101]
  "Address 5": u8[6] = [71, 111, 75, 117, 109, 102]
  "Address 6": u8[6] = [71, 111, 75, 117, 109, 103]
  "Address 7": u8[6] = [71, 111, 75, 117, 109, 103]
  "Address 8": u8[6] = [71, 111, 75, 117, 109, 105]
panel indicators:
  "Events": string
  "MAC TX Statistic": T1
  "Baseband Power": f64
  "Coerced LO frequency TX [Hz]": f64
  "Coerced LO frequency RX [Hz]": f64
  "Channel Estimation": cluster{"Element 1": i32[], "Element 2": f64[]}[]
  "TX Block Error Rate": f64
  "Coerced Power Level [dBm]": f64
  "RX Throughput": f64
  "Applied RX Gain [dB]": f64
  "RX Throughput [bits/s]": f64
  "Current TX Block Error Rate (BLER)": f64
  "RX Frequency [Hz]": f64
  "Overwritten by Device MAC Address": bool
  "Station Active": bool
  "Device Ready": bool
  "Baseband RX Power [dBFS]": f64
  "RX Constellation": c128[]
  "RX Power Spectrum": T4
  "TX Power Spectrum": T4
  "Data Transfer": bool
  "FIFO Full": bool
  "FIFO Full": bool
  "Data Transfer": bool
  "Compensated CFO [Hz]": f64
  "TX Data Dropped": bool
  "modulation and coding rate": string
  "MAC RX Statistic": T11
  "Target FIFO Overflow": bool
  "RF Input Power": f64[][]
  "CW and Backoff Indicators": T12
  "data after sifs count": u8
  "enable piggyback register": u32
  "count piggyback": u32
types:
  T1 = cluster{"TX after SIFS Requests Detected": u32, "TX after SIFS Requests Completed": u32, "TX after Backoff Requests Detected": u32, "TX after Backoff Requests Completed": u32}
  T2 = enum{"Baseband Loopback", "RF Loopback", "RF Multi Station"}
  T3 = enum{"RX1/RF 0", "RX2/RF 0", "RX1/RF 1", "RX2/RF 1"}
  T4 = cluster{"f0": f64, "df": f64, "magnitude": f64[]}
  T5 = cluster{"PhyTxStart": bool, "PhyTxEnd": bool, "PhyRxStart": bool, "PhyRxEnd": bool, "MacChannelState": bool, "MacTxStatus": bool, "PhyCcaTiming": bool, "PhyCcaTiming_2": bool, "PhyCcaTiming_3": bool}
  T6 = cluster{"Timestamp": u32, "Transferred Bytes": u32}
  T7 = cluster{"fpga ref": any, "bus instance": u32, "instruction FIFO depth": u32, "executing on FPGA target": bool, "show error call chain": bool}
  T8 = cluster{"Actual Gain [dB]": f64, "Attenuation Table Index": i32}
  T9 = cluster{"Attenuation Table [dB]": f64[][], "Frequencies [Hz]": f64[], "IQ Imbalance Table": "niUsrpRio Config v1 Host.lvlib__IQ Imbalance.gtype"[], "Gain Table": T8[][]}
  "niInstr Register Bus v0 Host.lvlib__Register Bus Session.gtype" = Queue<"niInstr Register Bus v0 Host.lvlib__Session Data.gtype">
  "Semaphore RefNum.gtype" = i32
  "niUsrpRio Config v1 Host.lvlib__DB Queue Reference.gtype" = Queue<"niUsrpRio Config v1 Host.lvlib__Daughterboard Data.gtype">
  "niUsrpRio Config v1 Host.lvlib__niUsrpRio Session.gtype" = cluster{"FPGA Interface": any, "RIO Interface Number": u32, "Data Clock Rate": u32, "FPGA Data Clock Rate": u32, "Global Settings Register Bus": "niInstr Register Bus v0 Host.lvlib__Register Bus Session.gtype", "Radio 0 Settings Register Bus": "niInstr Register Bus v0 Host.lvlib__Register Bus Session.gtype", "Radio 1 Settings Register Bus": "niInstr Register Bus v0 Host.lvlib__Register Bus Session.gtype", "Radio Settings Bus Semaphore": "Semaphore RefNum.gtype", "DB Queues": "niUsrpRio Config v1 Host.lvlib__DB Queue Reference.gtype"[], "Characterization Data Valid?": bool, "EEPROM Header": "niUsrpRio Config v1 Host.lvlib__EEPROM Header.gtype", "Device Data Header": "niUsrpRio Config v1 Host.lvlib__EEPROM Device Data Header.gtype", "EEPROM Characterization Header": "niUsrpRio Config v1 Host.lvlib__EEPROM Characterization Header.gtype", "Characterization Data": "niUsrpRio Config v1 Host.lvlib__Characterization Data.gtype"[], "FPGA Current Version": u32, "FPGA Oldest Compatible Version": u32, "Fixed Logic Current Version": u32, "Fixed Logic Oldest Compatible Version": u32, "FPGA Radio Settings Bus Current Version": u32, "FPGA Radio Settings Bus Oldest Compatible Version": u32, "FPGA Board Config Current Version": u32, "FPGA Board Config Oldest Compatible Version": u32, "Daughterboard Clock Rate": u32}
  T10 = cluster{"Timestamp": u32, "Transferred Bytes": u32, "Flow ID": u8}
  "802.11 Host Session.gtype" = cluster{"FPGA interface": "802.11 FGPA Reference.gtype", "send queue": Queue<u8[]>, "receive queue": Queue<u8[]>, "receive throughput queue": Queue<T6>, "UDP Receiver": UdpNetworkConnectionRefnum, "PN packet": u8[], "FlexRIO session": Queue<T7>, "FlexRIO TX Characterization Data": T9, "FlexRIO RX Characterization Data": T9, "USRP session": "niUsrpRio Config v1 Host.lvlib__niUsrpRio Session.gtype", "RF loop clock frequency": f64, "queue out": Queue<T10>}
  T11 = cluster{"Packet Starts detected": u32, "Frames from PHY": u32, "Frames with FCS pass": u32, "ACKs Received": u32}
  "USRP bandwidth.gtype" = enum{"40 MHz", "120 MHz", "160 MHz"}
  T12 = cluster{"CW": u16, "Last CWs": u16[30], "Last Backoffs": u16[30], "Last Random Numbers": UFXP(0.16)[30]}
  T13 = enum{"Default", "CW Max", "CW Min", "Fixed Backoff Value", "Backoff"}
  T14 = enum{"Default", "Fixed Backoff?", "Enable Piggyback?"}
  T15 = cluster{"TX after SIFS requests detected": u32, "TX after SIFS requests completed": u32, "TX after backoff requests detected": u32, "TX after backoff requests completed": u32}
  T16 = cluster{"Frames detected": u32, "Subframes received": u32, "Valid subframes received": u32, "ACKs received": u32}
  T17 = cluster{"PhyTxStart": bool, "PhyTxEnd": bool, "PhyRxStart": bool, "PhyRxEnd": bool, "MacChannelState": bool, "MacTxStatus": bool, "PhyCcaTiming": bool, "PhyRxGainChange": bool, "PhyRxAGCStateChange": bool}
  T18 = cluster{"remove header": bool, "block unsupported frame types": bool, "block FCS errors": bool, "block address mismatch": bool, "block header recognize error": bool}
diagram:
  sequence {
    frame 0 {
      $Events <- EmptyString
      $"Device Ready" <- FALSE
      $"Station Active" <- FALSE
      $Station <- FALSE
      $"RX Constellation" <- c128[] []
      $"RX Power Spectrum" <- T4 {all zero or empty}
      $"TX Power Spectrum" <- T4 {all zero or empty}
      $"Channel Estimation" <- cluster{"Element 1": i32[], "Element 2": f64[]}[] []
      $"MAC TX Statistic" <- T15 {all zero or empty}
      $"MAC RX Statistic" <- T16 {all zero or empty}
      $"Current TX Block Error Rate (BLER)" <- 0
      $"RX Throughput [bits/s]" <- 0
      $"Compensated CFO [Hz]" <- 0
      for (N = 51) {
        $"RX Throughput" <- NaN
        $"TX Block Error Rate" <- NaN
        $"Baseband Power" <- NaN
      }
      Initialize Array(element=NaN, size=51, size=2) -> w1
      $"RF Input Power" <- w1
    }
  }
  call "Create Stop Notifier.gvi"(error in=no error) -> (error out=w2)
  call "802.11 Host Init.gvi"(device=$"RIO Device", error in=w2, reference clock=$"Reference Clock", USRP bandwidth=$"USRP bandwidth") -> (session out=w3, error out=w4)
  case (w4) {
    frame Error {
      w5 = w4
    }
    frame No Error {
      $"Device Ready" <- TRUE
      $session <- w3
      w5 = w4
    }
  }
  s1 = w5  # shift register
  while {
    # RX Reception
    call "802.11 Unbundle Session.gvi"(session=$session) -> (FPGA interface=w6, receive queue=w7, receive throughput queue=w8)
    call "802.11 Receive RX ICP.gvi"(FPGA interface=w6, error in=s1, receive queue=w7, receive throughput queue=w8, enqueue decoded data=$"Station Active") -> (error out=w9)
    call "Check Stop.gvi"(error in=w9) -> (error out=w10, stop=w11)
    Wait Until Next Multiple(multiple to wait=0)
    next s1 = w10
    stop if w11
  }
  call "Stop On Error.gvi"(error in=s1) -> (error out=w12)
  s2 = w5  # shift register
  s3 = string[] []  # shift register
  while {
    call "802.11 Unbundle Session.gvi"(session=$session) -> (FPGA interface=w13)
    call "802.11 Prepare Constellation.gvi"(FPGA interface=w13, error in=s2, maximal number of subcarriers=4800) -> (error out=w14, data field constellation=w15, update constellation=w16)
    # update plots and indicators (slow)
    Logical And($"Station Active", w16) -> w17
    case (w17) {
      frame False { }
      frame True {
        $"RX Constellation" <- w15
      }
    }
    call "802.11 Read Event FIFO.gvi"(FPGA interface=w13, error in=s2) -> (raw events=w18, error out=w19)
    call "802.11 Prepare RX Power Spectrum.gvi"(FPGA interface=w13, error in=s2) -> (error out=w20, RX power spectrum=w21, update power spectrum=w22)
    call "802.11 Prepare TX Power Spectrum.gvi"(FPGA interface=w13, error in=s2) -> (error out=w23, TX power spectrum=w24, update power spectrum=w25)
    call "802.11 Prepare Channel Estimation.gvi"(FPGA interface=w13, error in=s2, channel subband=$"Primary Subband", subcarrier format=$"Subcarrier Format") -> (error out=w26, channel estimation=w27, update power spectrum=w28)
    call "802.11 Read Target Registers.gvi"(FPGA interface=w13, error in=s2) -> (error out=w29, target FIFO overflow=w30, compensated CFO=w31, RF input power=w32, MAC RX statistics=w33, MAC TX statistics=w34, signal power at packet start=w35)
    Merge Errors(w14, w20, w23, w26, w29, w19) -> (error out=w36)
    call "Check Stop.gvi"(error in=w36) -> (error out=w37, stop=w38)
    Logical And($"Station Active", w22) -> w39
    case (w39) {
      frame False, Default { }
      frame True {
        $"RX Power Spectrum" <- w21
      }
    }
    Logical And($"Station Active", w25) -> w40
    case (w40) {
      frame False, Default { }
      frame True {
        $"TX Power Spectrum" <- w24
      }
    }
    Logical And($"Station Active", w28) -> w41
    case (w41) {
      frame False, Default { }
      frame True {
        $"Channel Estimation" <- w27
      }
    }
    $"Target FIFO Overflow" <- w30
    $"Compensated CFO [Hz]" <- w31
    $"RF Input Power" <- w32
    $"Baseband Power" <- w35
    $"MAC RX Statistic" <- w33
    $"MAC TX Statistic" <- w34
    call "802.11 Events to String.gvi"(event data=w18, events to track=$"Events to Track") -> (event strings=w42)
    for {
      w43 = each element of w42
      Match Pattern(regular expression="PhyRxStart.ind ", string=w43) -> (offset past match=w45)
      Is Not Equal(x=w45, y=-1) -> w46
      append w46 to w44
    }
    Or Array Elements(Boolean array=w44)
    w47 = -12  # CFX data type offset
    Add(w35, w47) -> w48
    $"Baseband RX Power [dBFS]" <- w48
    Build Array[ConcatenateInputs=True](s3, w42) -> w49
    Delete From Array(inArray=w49, length (1)=10000) -> (deleted=w50)
    Select(s=$"Clear events", t=string[] [], f=w50) -> w51
    Concatenate Strings(w50) -> w52
    $Events <- w52
    Select(s=$None, t=T17 {all zero or empty}, f=$"Events to Track") -> w53
    w54 = T17 {"PhyTxStart"=TRUE, "PhyTxEnd"=TRUE, "PhyRxStart"=TRUE, "PhyRxEnd"=TRUE, "MacChannelState"=TRUE, "MacTxStatus"=TRUE, "PhyCcaTiming"=TRUE, "PhyRxGainChange"=TRUE, "PhyRxAGCStateChange"=TRUE}
    Select(s=$All, t=w54, f=w53) -> w55
    $"Events to Track" <- w55
    Wait Until Next Multiple(multiple to wait=250)
    next s2 = w37
    next s3 = w51
    stop if w38
  }
  call "Stop On Error.gvi"(error in=s2) -> (error out=w56)
  s4 = w5  # shift register
  while {
    Feedback Node(input=$"Station Active") -> w57
    Is Not Equal(x=$"Station Active", y=w57) -> w58
    # update plots and indicators (fast)
    case ($"Station Active") {
      frame False, Default {
        w59 = s4
      }
      frame True {
        call "802.11 Unbundle Session.gvi"(session=$session) -> (FPGA interface=w60, receive throughput queue=w61)
        call "802.11 Prepare Throughput Measurements.gvi"(reset=w58, FPGA interface=w60, receive throughput queue=w61, error in=s4, timing granularity=100) -> (error out=w59, TX block error rate=w62, RX throughput=w63)
        $"Current TX Block Error Rate (BLER)" <- w62
        $"TX Block Error Rate" <- w62
        $"RX Throughput [bits/s]" <- w63
        Divide(x=w63, y=1000000) -> w64
        $"RX Throughput" <- w64
      }
    }
    call "Check Stop.gvi"(error in=w59) -> (error out=w65, stop=w66)
    Wait Until Next Multiple(multiple to wait=100)
    next s4 = w65
    stop if w66
  }
  call "Stop On Error.gvi"(error in=s4) -> (error out=w67)
  while {
    Feedback Node(input=w68) -> w69
    for (N = w69) {
      Random Number() -> (number (0 to 1)=w71)
      To Fixed Point(number=w71) -> w72: UFXP(0.16) Saturate:ConvergentRounding
      append w72 to w70
    }
    call "802.11 Unbundle Session.gvi"(session=$session) -> (FPGA interface=w73)
    Type Cast(type=$"WiMAC FPGA Ref", x=w73) -> w74
    Host Fifo Write Node[FifoName="802.11 AFW Resources.grsc\\H2T Random Number FIFO"](data=w70, reference in=w74) -> (empty elements remaining=w68, error out=w75, reference out=w76)
    call "Chain Table.gvi"(Address 8=$"Address 1", Address 7=$"Address 2", Address 6=$"Address 3", Address 5=$"Address 4", Address 4=$"Address 5", Address 3=$"Address 6", Address 2=$"Address 7", Address 1=$"Address 8") -> (chain table=w77)
    Property Node(instance in=w76, "CW Max"=$"CW Max", "CW Min"=$"CW Min", "Fixed backoff value"=$"Fixed backoff value", "Fixed backoff?"=$"Fixed backoff?", "Exponential Backoff Ratio"=$"Exponential Backoff Ratio", "time to wait for decoding packet"=$"time to wait for decoding packet", "Backoff: CW Max"=$"Backoff: CW Max", "Backoff: CW Min"=$"Backoff: CW Min", "Backoff: Exponential Backoff Ratio"=$"Backoff: Exponential Backoff Ratio", "Backoff: Fixed Backoff Value"=$"Backoff: Fixed Backoff Value", "Backoff: Fixed Backoff?"=$"Backoff: Fixed Backoff?", "Piggyback: Enable Piggyback"=$"Piggyback: Enable Piggyback", "Piggyback: Piggyback Address"=$"Piggyback: Piggyback Address", "Enable Piggyback"=$"Enable Piggyback", "Use RTR instead of Data?"=$"Use RTR instead of Data?", "Set Backoff Done Pulse to False"=$"Set Backoff Done Pulse to False", "Input: chain table"=w77) -> ("CW and Backoff Indicators"=w78, "data after sifs count"=w79, "count piggyback"=w80, "enable piggyback register"=w81, "Has been transferred?"=w82, "Chain Table"=w83, "ID table"=w84, "Is header?"=w85, "PiggyBack Address"=w86, "Head Mac Address"=w87, "Check if it is matching?"=w88, "Check the ID"=w89, "Order in Chain"=w90, "Index of Max ID"=w91, "Piggy"=w92, error out=w93)
    $"CW and Backoff Indicators" <- w78
    $"data after sifs count" <- w79
    $"chain table_2" <- w77
    $"count piggyback" <- w80
    $"enable piggyback register" <- w81
    $"Has been transferred?" <- w82
    $"chain table" <- w83
    $"chain order" <- w84
    $"Is header?" <- w85
    $"PiggyBack Address" <- w86
    $"Head Mac Address" <- w87
    $"Check if it is matching?" <- w88
    $"Check the ID" <- w89
    $"Order in Chain" <- w90
    $"Index of Max ID" <- w91
    $Piggy <- w92
    Merge Errors(w93, w75, w5) -> (error out=w94)
    call "Check Stop.gvi"(error in=w94) -> (error out=w95, stop=w96)
    stop if w96
  }
  call "Stop On Error.gvi"(error in=w95) -> (error out=w97)
  Udp Open(error in=w5, net address=0, port=0, service name="", timeout ms=25000) -> (connection ID=w98, error out=w99)
  call "Set Socket Option.gvi"(connection in=w98, level=0xFFFF, option name=0x1001, value=1024000, error in=w99) -> (error out=w100, connection out=w101)
  s5 = w100  # shift register
  s6 = w101  # shift register
  while {
    # UDP send and receive
    call "802.11 Unbundle Session.gvi"(session=$session) -> (send queue=w102, receive queue=w103, UDP receiver=w104, PN packet=w105)
    case ($"Station Active") {
      frame False, Default {
        w106 = s5
        w107 = s6
      }
      frame True {
        Array Subset(array=w105, length0=$"PN Data Packet Size") -> w108
        case ($"Data Source") {
          frame "UDP" {
            # UDP
            call "802.11 Receive UDP Data.gvi"(UDP receiver=w104, send queue=w102, error in=s5) -> (data transfer=w110, error out=w109, FIFO full=w111)
            $"FIFO Full" <- w111
          }
          frame "PN Data" {
            # PN data
            call "802.11 Send PN Data.gvi"(PN packets per second=$"PN Packets per Second", send queue=w102, PN data=w108, error in=s5) -> (data transfer=w110, error out=w109)
          }
          frame "Manual", Default {
            # Manual
            case ($"Trigger TX") {
              frame False, Default {
                w109 = s5
                w110 = $"Trigger TX"
              }
              frame True {
                Enqueue Element(element=w108, error in=s5, queue=w102, timeout in ms=-1) -> (error out=w109, queue out=w112)
                w110 = $"Trigger TX"
              }
            }
          }
        }
        $"Data Transfer" <- w110
        Is Equal(x=$"Data Sink", y="UDP") -> w113
        call "802.11 Send UDP Data.gvi"(target port=$"Transmit Port", target IP address=$"Transmit IP Address", receive queue=w103, UDP sender=s6, enable=w113, error in=s5) -> (FIFO full=w114, error out=w115, UDP sender dup=w107, data transfer=w116)
        $"Data Transfer" <- w116
        $"FIFO Full" <- w114
        Merge Errors(w109, w115) -> (error out=w106)
      }
    }
    call "Check Stop.gvi"(error in=w106) -> (error out=w117, stop=w118)
    Wait Until Next Multiple(multiple to wait=0)
    next s5 = w117
    next s6 = w107
    stop if w118
  }
  call "Stop On Error.gvi"(error in=s5) -> (error out=w119)
  Udp Close(connection ID=s6, error in=w119) -> (error out=w120)
  s7 = w5  # shift register
  while {
    # TX transmission
    call "802.11 Unbundle Session.gvi"(session=$session) -> (FPGA interface=w121, send queue=w122)
    w123 = $"Station Active"
    while {
      Dequeue Element(error in=s7, queue=w122, timeout in ms=0) -> (element=w124, error out=w125, timed out?=w126)
      Logical And(w123, not w126) -> w127
      case (w127) {
        frame False {
          w128 = w125
        }
        frame True {
          call "802.11 Subcarrier Format to Configuration.gvi"(MCS=$MCS, subcarrier format=$"Subcarrier Format", error in=w125) -> (error out=w129, format=w130, bandwidth=w131, valid configuration=w132)
          Is Not Equal(x=$"Operation Mode", y="RF Multi Station") -> w133
          Select(s=w133, t=$"Device MAC Address", f=$"Destination MAC Address") -> w134
          case (w132) {
            frame False, Default {
              w135 = FALSE
              w128 = w129
            }
            frame True {
              call "802.11 Send TX ICP.gvi"(FPGA interface=w121, MCS=$MCS, device MAC address=$"Device MAC Address", error in=w129, destination MAC address=w134, Flow ID=$"Flow ID", payload=w124, format=w130, bandwidth=w131) -> (dropped?=w135, error out=w128)
            }
          }
          $"TX Data Dropped" <- w135
          $"Overwritten by Device MAC Address" <- w133
        }
      }
      call "Check Stop.gvi"(error in=w128) -> (error out=w136, stop=w137)
      Logical Or(w137, w126) -> w138
      stop if w138
    }
    call "Check Stop.gvi"(error in=w136) -> (error out=w139, stop=w140)
    Wait Until Next Multiple(multiple to wait=0)
    next s7 = w139
    stop if w140
  }
  call "Stop On Error.gvi"(error in=s7) -> (error out=w141)
  s8 = w5  # shift register
  while {
    # configuration
    call "802.11 Unbundle Session.gvi"(session=$session) -> (FPGA interface=w142)
    Feedback Node(input=$"Station Active") -> w143
    case ($"Station Active") {
      frame False, Default {
        w144 = s8
      }
      frame True {
        Is Not Equal(x=$"Station Active", y=w143) -> w145
        call "802.11 Gain Control.gvi"(initialize=w145, RX Port (USRP only)=$"RX Port (USRP only)", session=$session, AGC=$AGC, error in=s8, Manual RX gain [dB]=$"Manual RX gain [dB]", RX Frequency [Hz]=$"RX Frequency [Hz]", TX Port (USRP only)=$"TX Port (USRP only)") -> (Applied RX Gain [dB]=w146, error out=w147)
        $"Applied RX Gain [dB]" <- w146
        call "802.11 Subcarrier Format to Configuration.gvi"(MCS=$MCS, subcarrier format=$"Subcarrier Format", error in=s8) -> (error out=w148, format=w149)
        call "802.11 Configure Dynamic Parameters.gvi"(FPGA interface=w142, error in=w148, format=w149, transmit ACK=$"Transmit ACK", CCA energy detection threshold=$"CCA Energy Detection Threshold [dBm]") -> (error out=w150)
        Merge Errors(w147, w150) -> (error out=w144)
      }
    }
    w151 = $Station
    Feedback Node(input=w151) -> w152
    Logical Exclusive Or(w151, w152) -> w153
    case (w153) {
      frame False, Default {
        w154 = s8
      }
      frame True {
        case (w151) {
          frame False, Default {
            sequence {
              frame 0 {
                $"Station Active" <- w151
              }
            }
            call "802.11 Unbundle Session.gvi"(session=$session) -> (UDP receiver=w155)
            Udp Close(connection ID=w155, error in=s8) -> (error out=w156)
            call "Clear Errors.gvi"(specific error code to clear=1, error in=w156) -> (error out=w157)
            call "802.11 Abort RF Streams.gvi"(session=$session, error in=w157) -> (error out=w154)
          }
          frame True {
            $"RX Frequency [Hz]" <- $"TX Frequency [Hz]"
            call "802.11 FPGA Target Configuration.gvi"() -> (maximum gain=w158, enable DC offset correction=w159)
            w160 = T18 {"remove header"=TRUE, "block unsupported frame types"=TRUE, "block FCS errors"=TRUE, "block address mismatch"=TRUE, "block header recognize error"=TRUE}
            call "802.11 Configure Static Parameters.gvi"(session in=$session, error in=s8, primary subband=$"Primary Subband", operation mode=$"Operation Mode", enable DC offset correction=w159, MPDU filter configuration=w160, device MAC address=$"Device MAC Address") -> (session dup=w161, error out=w162)
            call "802.11 Reset Statistics.gvi"(session in=w161, error in=w162, reset RX statistics=TRUE, reset TX statistics=TRUE) -> (error out=w163, session dup=w164)
            call "802.11 Configure TX RF.gvi"(TX port=$"TX Port (USRP only)", session=w164, TX frequency=$"TX Frequency [Hz]", TX power level=$"Power Level [dBm]", error in=w163) -> (session dup=w165, error out=w166, coerced TX power level=w167, coerced LO frequency=w168)
            call "802.11 Configure RX RF.gvi"(RX frequency=$"TX Frequency [Hz]", session=w165, RX gain=w158, error in=w166, RX port=$"RX Port (USRP only)") -> (error out=w169, session dup=w170, coerced RX gain=w171, coerced LO frequency=w172)
            call "802.11 Configure AGC Registers.gvi"(TX Port=$"TX Port (USRP only)", enable AGC=FALSE, session=w170, RX port=$"RX Port (USRP only)", error in=w169) -> (error out=w173, session dup=w174)
            call "802.11 Set Power Calibration Offset.gvi"(session=w174, frequency=$"TX Frequency [Hz]", error in=w173, RX port=$"RX Port (USRP only)") -> (session dup=w175, error out=w176)
            call "802.11 Configure RF Streams.gvi"(TX port=$"TX Port (USRP only)", RX port=$"RX Port (USRP only)", session=w175, error in=w176) -> (session dup=w177, error out=w178)
            call "802.11 Configure Data Source.gvi"(error in=w178, receive port=$"Receive Port", session in=w177) -> (error out=w154, session out=w179, success?=w180)
            $session <- w179
            sequence {
              frame 0 {
                $Station <- w180
                $"Station Active" <- w151
              }
            }
            $"Coerced LO frequency RX [Hz]" <- w172
            $"Applied RX Gain [dB]" <- w171
            $"Coerced LO frequency TX [Hz]" <- w168
            $"Coerced Power Level [dBm]" <- w167
          }
        }
      }
    }
    call "802.11 Reset Statistics.gvi"(session in=$session, error in=s8, reset RX statistics=$"reset RX staistics", reset TX statistics=$"reset TX staistics") -> (error out=w181)
    call "802.11 Subcarrier Format to Configuration.gvi"(MCS=$MCS, subcarrier format=$"Subcarrier Format", error in=w181) -> (modulation and coding rate=w182, error out=w183)
    Merge Errors(w144, w154, w183) -> (error out=w184)
    call "Create Stop.gvi"(error in=w184, stop in=$Stop) -> (error out=w185)
    call "Check Stop.gvi"(error in=w185) -> (error out=w186, stop=w187)
    Wait Until Next Multiple(multiple to wait=100)
    $"modulation and coding rate" <- w182
    next s8 = w186
    stop if w187
  }
  call "Stop On Error.gvi"(error in=s8) -> (error out=w188)
  Merge Errors(w188, w141, w12, w120, w56, w67, w97) -> (error out=w189)
  sequence {
    frame 0 {
      w190 = $session
    }
  }
  call "802.11 Host Release.gvi"(session=w190, error in=w189) -> (error out=w191)
  call "Simple Error Handler.gvi"(type of dialog="OK message", error in=w191)
