vi "802.11 FPGA STA.gvi"   [LabVIEW Communications System Design Suite 2.0.1]
panel controls:
  "reg.host read.go rcvd 0": bool
  "reg.notify host.go rcvd 0": bool
  "reg.reset 0": bool
  "RF 0/Rx/Enable": bool
  "RF 0/Tx/Enable": bool
  "RF 1/Rx/Enable": bool
  "RF 1/Tx/Enable": bool
  "ATR State": enum{"Idle", "Rx", "Tx", "Duplex"} = "Idle"
  "Radio Control Destination": T1 = "Radio 0 Config"
  "lo lpf enable": bool
  "power enable": bool
  "mixer enable": bool
  "tx.configuration": T2 = {"power enable"=TRUE, "mixer enable"=TRUE, "gain"=0}
  "RX data source": T3 = "RF"
  "packet start sample index": u16
  "rearm packet start generator": bool
  "bypass synchronization": bool
  "reset MAC RX statistics": bool
  "noise coefficient": FXP(8.8) = 10
  "mute RX while TX active?": bool = TRUE
  "number of samples to capture": u16 = 1024
  "produce silent samples": bool
  "MPDU filter config": T7 = {"remove header"=TRUE, "block unsupported frame types"=TRUE, "block FCS errors"=TRUE, "block address mismatch"=TRUE, "block header recognize error"=TRUE}
  "power calibration offset": FXP(10.3)
  "CCA energy detect threshold": FXP(10.3) = -62
  "RF gain": FXP(10.3)
  "number of samples before trigger": u16
  "synchronization settings": T8 = {"maximal normalization threshold"=65536, "peak timing metric threshold"=0.5, "consecutive samples over threshold"=10, "valley timing metric threshold"=-0.5, "consecutive samples under threshold"=10, "autocorelation threshold"=0.5, "expected peak valley distance"=608, "maximum peak valley distance deviation"=64, "samples to shift frame start"=-32, "use static CFO?"=FALSE, "static CFO"=0}
  "trigger condition": T9 = "Immediate"
  "manual trigger": bool
  "AGC tresholds": T10
  "AGC timeout": i32 = 3500
  "enable AGC": bool
  "manual PhyTxStart.req": cluster{"TX vector": T11, "Valid": bool}
  "bypass MAC TX": bool
  "RX TX turnaround time": u32 = 24
  "reset MAC TX statistics": bool
  "suppress ACK": bool
  "ACK bandwidth": enum{"20 MHz", "40 MHz", "80 MHz"} = "20 MHz"
  "rx.reset": bool = TRUE
  "rx.output sample rate": UFXP(1.47)
  "rx.delay": FXP(0.16)
  "rx 0.frequency shift": FXP(0.48)
  "rx 0.phase": FXP(0.21)
  "rx 0.impairments": T13 = {"inline gain I"=-1, "inline gain Q"=0.999992370605, "cross gain I"=0.999992370605, "cross gain Q"=0, "pre-gain offset I"=0, "pre-gain offset Q"=-1, "post-gain offset I"=0, "post-gain offset Q"=0.999992370605}
  "rx.abort": bool
  "tx.abort": bool
  "tx.reset": bool = TRUE
  "tx.input sample rate": UFXP(1.47)
  "tx.delay": FXP(0.18)
  "tx 0.frequency shift": FXP(0.48)
  "tx 0.phase": FXP(0.21)
  "tx 0.impairments": T13 = {"inline gain I"=0.999992370605, "inline gain Q"=0.999992370605, "post-gain offset I"=0.999992370605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}
  "tx 0.gain": T14 = {"gain I"=1, "gain Q"=1}
  "rx 1.impairments": T13 = {"inline gain I"=-0.999992370605, "inline gain Q"=0.999992370605, "cross gain I"=-0.999992370605, "cross gain Q"=0, "pre-gain offset I"=-1, "pre-gain offset Q"=0, "post-gain offset I"=0, "post-gain offset Q"=0}
  "rx 1.frequency shift": FXP(0.48)
  "rx 1.phase": FXP(0.21)
  "tx 1.impairments": T13 = {"inline gain I"=0.999992370605, "inline gain Q"=0.999992370605, "post-gain offset I"=-1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}
  "tx 1.frequency shift": FXP(0.48)
  "tx 1.phase": FXP(0.21)
  "tx 1.gain": T14 = {"gain I"=1, "gain Q"=1}
  "rx 0.stream enable": bool
  "rx 1.stream enable": bool
  "tx 0.stream enable": bool
  "tx 1.stream enable": bool
  "Data clock cycles per tick (0.1us)": u16 = 20
  "Data clock cycles per OFDM symbol": u16 = 480
  "rx.rf channel": UFXP(1.0)
  "tx.rf channel": UFXP(1.0)
  "enable DC offset correction": bool = TRUE
  "data clock locked?": bool
  "format": enum{"a", "ac"} = "a"
  "channel selector": UFXP(2.0)
  "device MAC address": u8[6]
  "DC centered signal": bool = TRUE
  "daughterboard": "niUsrpRio Config v1 Host.lvlib__DB Types.gtype" = "sbx"
  "antenna configuration": "niUsrpRio Config v1 Host.lvlib__Antenna Configuration.gtype" = "TX1 RX1 transmits and RX2 receives"
  "spi address": u8 = 7
  "cpld enable": bool = TRUE
  "time to wait for decoding packet": u32
  "CW Max": u16
  "CW Min": u16
  "Fixed backoff?": bool
  "Exponential Backoff Ratio": UFXP(6.10)
  "Fixed backoff value": u16
  "Backoff: Fixed Backoff Value": "U16 Register Names Enum.gtype" = "CW Max"
  "Backoff: CW Max": "U16 Register Names Enum.gtype" = "CW Max"
  "Backoff: Exponential Backoff Ratio": "FXP 6.10 Register Names Enum.gtype" = "Default"
  "Backoff: CW Min": "U16 Register Names Enum.gtype" = "CW Max"
  "Backoff: Fixed Backoff?": "Boolean Register Names Enum.gtype" = "Default"
  "Set Backoff Done Pulse to False": bool
  "Piggyback: Piggyback Address": "MAC Address Register Names.gtype" = "Default"
  "Piggyback: Enable Piggyback": "Boolean Register Names Enum.gtype" = "Default"
  "Enable Piggyback": bool
  "Use RTR instead of Data?": bool
  "Input: chain table": u64[8]
  "Host queue length (packets)": u32
  "Queue threshold for contention": u32
  "packet size (bytes)": u32
  "reset permission to contend": bool
panel indicators:
  "reg.notify host.go 0": bool
  "reg.host read.data 0": cluster{"go": bool, "data": u32}
  "compensated CFO": FXP(0.48)
  "MAC RX statistics": T4
  "PhyRxStart.ind": T5
  "PhyRxEnd.ind": T6
  "T2H RX Data overflow": u16
  "T2H Constallation overflow": u16
  "T2H RX Bit Processing Output FIFO overflow": u16
  "T2H RX Power Spectrum overflow": u16
  "T2H Channel Estimation overflow": u16
  "last applied gain": UFXP(5.1)
  "RF input power at packet start": FXP(10.3)
  "signal power at packet start": FXP(10.3)
  "RF input power": FXP(10.3)
  "signal power": FXP(10.3)
  "out of range?": bool
  "MAC TX statistics": T12
  "PhyTxStart.req": cluster{"TX vector": T11, "Valid": bool}
  "PhyTxEnd.ind": cluster{"Valid": bool}
  "internal loopback FIFO overflow": u16
  "TX to RF FIFO overflow": u16
  "T2H TX Baseband FIFO overflow": u16
  "T2H TX Bit Processing Output FIFO overflow": u16
  "rx.samples processed": u32
  "rx.number of IQ data overflows": u64
  "rx.number of overflows": u32
  "tx.samples processed": u32
  "tx.underflows": u32
  "tx.number of IQ data overflows": u64
  "rx.dsp reset done": bool
  "tx.dsp reset done": bool
  "tx.state": "Stream Control State.gtype"
  "rx.state": "Stream Control State.gtype"
  "Timestamp": u32
  "DC average": CFXP(1.17)
  "CW and Backoff Indicators": T15
  "data after sifs count": u8
  "enable piggyback register": u32
  "count piggyback": u32
  "Has been transferred?": bool
  "ID table": u8[8]
  "Chain Table": u64[8]
  "Is header?": bool
  "Order in Chain": u8
  "Head Mac Address": u8[6]
  "PiggyBack Address": u8[6]
  "Check if it is matching?": bool
  "Check the ID": u8
  "Index of Max ID": i32
  "Piggy": u64
  "authorized to contend?": bool
  "FPGA queue length": u32
  "count DIFS after ACK done": u32
types:
  T1 = enum{"Identification", "Board Config", "Global Config", "Radio 0 Config", "Radio 1 Config", "Synchronization", "Time", "Future Events"}
  T2 = cluster{"power enable": bool, "mixer enable": bool, "gain": u8}
  T3 = enum{"RF", "BB Data From Host", "Internal Loopback"}
  T4 = cluster{"number of frames detected": u32, "number of subframes received": u32, "number of valid subframes received": u32, "number of ACKs received": u32, "valid": bool}
  T5 = cluster{"Format": enum{"a", "ac"}, "Bandwidth": enum{"20 MHz", "40 MHz", "80 MHz"}, "PSDU Length": u32, "MCS": UFXP(4.0), "valid": bool}
  T6 = cluster{"Format Violation": bool, "Timing valid": bool, "Timing value": u32, "valid": bool}
  T7 = cluster{"remove header": bool, "block unsupported frame types": bool, "block FCS errors": bool, "block address mismatch": bool, "block header recognize error": bool}
  T8 = cluster{"maximal normalization threshold": UFXP(19.15), "peak timing metric threshold": FXP(2.6), "consecutive samples over threshold": u8, "valley timing metric threshold": FXP(2.6), "consecutive samples under threshold": u8, "autocorelation threshold": UFXP(2.14), "expected peak valley distance": u16, "maximum peak valley distance deviation": u8, "samples to shift frame start": i8, "use static CFO?": bool, "static CFO": FXP(0.48)}
  T9 = enum{"Immediate", "RX Packet Start", "TX Paket Start", "CCA energy detected"}
  T10 = cluster{"AGC active threshold": FXP(10.3), "AGC threshold 1": FXP(10.3), "AGC threshold 2": FXP(10.3), "AGC threshold 3": FXP(10.3)}
  T11 = cluster{"format": enum{"a", "ac"}, "bandwidth": enum{"20 MHz", "40 MHz", "80 MHz"}, "length": u32, "MCS": UFXP(4.0), "TX power level": UFXP(4.0), "Scrambler seed": UFXP(7.0)}
  T12 = cluster{"number of TX after SIFS requests detected": u32, "number of TX after SIFS requests completed": u32, "number of TX after backoff requests detected": u32, "number of TX after backoff requests completed": u32}
  T13 = cluster{"inline gain I": FXP(1.17), "inline gain Q": FXP(1.17), "cross gain I": FXP(1.17), "cross gain Q": FXP(1.17), "pre-gain offset I": FXP(1.17), "pre-gain offset Q": FXP(1.17), "post-gain offset I": FXP(1.17), "post-gain offset Q": FXP(1.17)}
  T14 = cluster{"gain I": FXP(3.21), "gain Q": FXP(3.21)}
  "Stream Control State.gtype" = enum{"Idle", "Active"}
  "niUsrpRio Config v1 Host.lvlib__DB Types.gtype" = enum{"sbx", "cbx", "wbx", "unknown", "ubx"}
  "niUsrpRio Config v1 Host.lvlib__Antenna Configuration.gtype" = enum{"TX1 RX1 transmits and RX2 receives", "TX1 RX1 receives and RX2 is unused"}
  T15 = cluster{"CW": u16, "Last CWs": u16[30], "Last Backoffs": u16[30], "Last Random Numbers": UFXP(0.16)[30]}
  "U16 Register Names Enum.gtype" = enum{"Default", "CW Max", "CW Min", "Fixed Backoff Value", "Backoff"}
  "FXP 6.10 Register Names Enum.gtype" = enum{"Default", "Exponential Backoff Ratio"}
  "Boolean Register Names Enum.gtype" = enum{"Default", "Fixed Backoff?", "Enable Piggyback?"}
  "MAC Address Register Names.gtype" = enum{"Default", "Piggyback MAC Address"}
  "Cluster Constant.gtype" = cluster{"CW Max Reg": RegisterDataType<u16>, "CW Min Reg": RegisterDataType<u16>, "Fixed Backoff Value Reg": RegisterDataType<u16>, "Backoff": RegisterDataType<u16>, "Exponential Backoff Ratio Reg": RegisterDataType<UFXP(6.10)>, "Fixed Backoff Reg": RegisterDataType<bool>, "U16 Default": RegisterDataType<u16>, "FXP <6.10> Default": RegisterDataType<UFXP(6.10)>, "Boolean Default": RegisterDataType<bool>, "Has been transferred?": RegisterDataType<bool>, "If is the header?": RegisterDataType<bool>}
  T16 = cluster{"MPDU subtype": enum{"ACK"}, "destination MAC address": u8[6], "valid": bool}
  T17 = cluster{"CCA energy detection busy": u8, "CCA signal detection busy": bool, "frame timing valid": bool, "frame timing value": u32, "frame timing use DIFS": bool}
  T18 = cluster{"5 MHz": bool, "10 MHz": bool, "20 MHz": bool, "40 MHz": bool, "80 Mhz": bool, "160 MHz": bool}
  T19 = cluster{"format": enum{"a", "ac"}, "channel selector": UFXP(2.0), "device MAC address": u8[6], "DC centered signal": bool, "supported bandwidths": T18}
  T20 = cluster{"global timestamp": RegisterDataType<u32>, "OFDM symbol pulse": RegisterDataType<bool>, "TX active": RegisterDataType<bool>, "channel state indication": RegisterDataType<T17>, "MPDU generation request": RegisterDataType<T16>, "shared properties": RegisterDataType<T19>}
  T21 = cluster{"CCA energy detection busy": u8, "CCA signal detection busy": bool}
  T22 = enum{"Idle", "Wait for second measurement", "AGC active", "Gain locked"}
  T23 = cluster{"trigger gain setting": bool, "gain": UFXP(5.1)}
  "802.11 PHY-SAP.gtype" = cluster{"PSDU (RX)": any, "PSDU (TX)": any, "CCA detection": RegisterDataType<T21>, "PhyRxStart.req": HandshakeDataType<T5>, "PhyRxEnd.ind": HandshakeDataType<T6>, "channel state indication": HandshakeDataType<T17>, "PhyTxStart.req": HandshakeDataType<cluster{"TX vector": T11, "Valid": bool}>, "PhyTxEnd.ind": HandshakeDataType<cluster{"Valid": bool}>, "PHY RX AGC state indication": HandshakeDataType<cluster{"AGC state": T22, "AGC enabled": bool}>, "PHY RX Gain change indication": HandshakeDataType<T23>}
  T24 = cluster{"RF to RX FIFO": any, "internal loopback FIFO": any, "TX to RF FIFO": any, "Gain Settings FIFO": any}
  T25 = cluster{"output sample rate": UFXP(1.47), "delay": FXP(0.16), "frequency shift": FXP(0.48), "impairments": T13, "phase": FXP(0.21)}
  T26 = cluster{"frequency shift": FXP(0.48), "impairments": T13, "phase": FXP(0.21), "input sample rate": UFXP(1.47), "gain": T14, "delay": FXP(0.18)}
diagram:
  Register Create(initial value=1024) -> (reference out=w1)
  Register Create(initial value=8) -> (reference out=w2)
  Register Create(initial value=4) -> (reference out=w3)
  Register Create(initial value=0) -> (reference out=w4)
  Register Create(initial value=0) -> (reference out=w5)
  Register Create(initial value=FALSE) -> (reference out=w6)
  Register Create(initial value=0) -> (reference out=w7)
  Register Create(initial value=0) -> (reference out=w8)
  Register Create(initial value=FALSE) -> (reference out=w9)
  Register Create(initial value=FALSE) -> (reference out=w10)
  Register Create(initial value=FALSE) -> (reference out=w11)
  Property Node(instance in="Cluster Constant.gtype" {all zero or empty}, "CW Max Reg"=w1, "CW Min Reg"=w2, "Fixed Backoff Value Reg"=w3, "Backoff"=w4, "Exponential Backoff Ratio Reg"=w5, "Fixed Backoff Reg"=w6, "U16 Default"=w7, "FXP <6.10> Default"=w8, "Boolean Default"=w9, "Has been transferred?"=w10, "If is the header?"=w11) -> (instance out=w12)
  Register Create(initial value=0) -> (reference out=w13)
  Register Create(initial value=FALSE) -> (reference out=w14)
  w15 = T16 {"MPDU subtype"="ACK", "destination MAC address"=[0, 0, 0, 0, 0, 0], "valid"=FALSE}
  Register Create(initial value=w15) -> (reference out=w16)
  Register Create(initial value=FALSE) -> (reference out=w17)
  Register Create(initial value=T17 {all zero or empty}) -> (reference out=w18)
  w19 = T19 {"format"="a", "channel selector"=0, "device MAC address"=[0, 0, 0, 0, 0, 0], "DC centered signal"=FALSE, "supported bandwidths"={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}}
  Register Create(initial value=w19) -> (reference out=w20)
  Property Node(instance in=T20 {all zero or empty}, "global timestamp"=w13, "MPDU generation request"=w16, "channel state indication"=w18, "TX active"=w17, "OFDM symbol pulse"=w14, "shared properties"=w20) -> (instance out=w21)
  FIFO Create(data type=u8 0) -> (reference out=w22)
  FIFO Create(data type=u8 0) -> (reference out=w23)
  Register Create(initial value=T21 {all zero or empty}) -> (reference out=w24)
  Handshake Create(data type=T5 {all zero or empty}) -> (reference out=w25)
  Handshake Create(data type=T6 {all zero or empty}) -> (reference out=w26)
  Handshake Create(data type=T17 {all zero or empty}) -> (reference out=w27)
  Handshake Create(data type=cluster{"TX vector": T11, "Valid": bool} {all zero or empty}) -> (reference out=w28)
  Handshake Create(data type=cluster{"Valid": bool} {all zero or empty}) -> (reference out=w29)
  w30 = cluster{"AGC state": T22, "AGC enabled": bool} {all zero or empty}
  Handshake Create(data type=w30) -> (reference out=w31)
  Handshake Create(data type=T23 {all zero or empty}) -> (reference out=w32)
  Property Node(instance in="802.11 PHY-SAP.gtype" {all zero or empty}, "PSDU (RX)"=w22, "PSDU (TX)"=w23, "CCA detection"=w24, "PhyRxStart.req"=w25, "PhyRxEnd.ind"=w26, "channel state indication"=w27, "PhyTxStart.req"=w28, "PhyTxEnd.ind"=w29, "PHY RX AGC state indication"=w31, "PHY RX Gain change indication"=w32) -> (instance out=w33)
  clock-driven loop (clock = "802.11 AFW Resources.grsc\\MACSLOW") (after w12) forever {
    call "802.11 PHY-SAP Read MAC.gcdl"(PHY-SAP=w33) -> (CCA detection=w34, PSDU=w35, PSDU valid=w36, PhyRxStart.req=w37, PhyTxEnd.ind=w38, PhyRxEnd.ind=w39, PHY RX AGC state indication=w40, PHY RX Gain change indication=w41)
    Property Node(instance in=w21) -> ("shared properties"=w42, "global timestamp"=w43, "channel state indication"=w44)
    Register Read(reference in=w43) -> (data=w45)
    call "Piggyback.gcdl"(Piggyback: Piggyback Address=$"Piggyback: Piggyback Address", Piggyback: Enable Piggyback=$"Piggyback: Enable Piggyback") -> (Piggyback Address=w46, Piggyback Enable?=w47)
    Property Node(instance in=w37) -> ("valid"=w48)
    Feedback Node(enable?=w48, initial value=u8[6] default, input=w49) -> w50
    Feedback Node(input=w51) -> w52
    # w38: PhyTxEnd.ind
    call "Reset to next Chain.gcdl"(TX after backoff done=w52, global clock counter=w45) -> (DIFS after ACK done=w53)
    call "802.11 MAC RX.gcdl"(PSDU=w35, input valid=w36, PHY RX start indication=w37, PHY RX end indication=w39, PHY CCA timing indication=w34, reset MAC RX statistics=$"reset MAC RX statistics", device MAC address=w50, MPDU filter config=$"MPDU filter config", Enable Piggyback=w47, piggyback MAC address=w46, DIFS after ACK done=w53, global clock counter=w45, Input: chain table=$"Input: chain table") -> (MAC RX statistics=w54, channel state indication=w55, ICP SDU=w56, output valid=w57, MPDU generation request=w58, ACK Received Pulse=w59, Piggyback?=w60, count DIFS after ACK done=w61)
    $"count DIFS after ACK done" <- w61
    call "802.11 RX Data Sink.gcdl"(ICP SDU=w56, input valid=w57, FIFO reference="802.11 AFW Resources.grsc\\T2H RX Data") -> (FIFO overflow count=w62)
    $"T2H RX Data overflow" <- w62
    # w58: MPDU request
    Register Write(data=w55, reference in=w44) -> (reference out=w63)
    # w45: global time reference
    Register Read(reference in=w63) -> (data=w64)
    Register Read(reference in=w42) -> (data=w65)
    # w33: PHY SAP
    Property Node(instance in=w65) -> ("format"=w66, "device MAC address"=w49)
    # w63: channel state indication
    Feedback Node(input=w67) -> w68
    # w69: TX Data after SIFS
    call "802.11 Prepare ACK.gcdl"(format=w66, bandwidth=$"ACK bandwidth", MPDU generation request=w58, MAC ready=w68, suppress=$"suppress ACK") -> (MPDU block=w70, output valid=w71, TX after SIFS request=w72, TX Data After SIFS=w69)
    Register Read(reference in="802.11 AFW Resources.grsc\\Backoff") -> (data=w73)
    Property Node(instance in="802.11 AFW Resources.grsc\\H2T TX Data") -> ("used elements"=w74)
    call "manage permission to contend.gcdl"(Host queue length (packets)=$"Host queue length (packets)", FPGA queue length (bytes)=w74, Queue threshold for contention (packets)=$"Queue threshold for contention", packet size (bytes)=$"packet size (bytes)", reset permission to contend=$"reset permission to contend") -> (authorized to contend?=w75)
    Feedback Node(input=w76) -> w77
    call "802.11 TX Data Source.gcdl"(ready for output=w77, H2T TX Data="802.11 AFW Resources.grsc\\H2T TX Data", bypass MAC TX=$"bypass MAC TX") -> (ICP data=w78, output valid=w79, elements available=w80)
    Feedback Node(input=w81) -> w82
    Feedback Node(input=w83) -> w84
    call "802.11 Prepare MPDU.gcdl"(ICP=w78, input valid=w79, elements available=w80, MAC ready for input=w82, TX status indication=w84, backoff value=w73, Use RTR instead of Data?=$"Use RTR instead of Data?", authorized to contend?=w75) -> (MPDU block=w85, ready for input=w76, output valid=w86, TX after backoff request=w87)
    Logical Or(w70, w85) -> w88
    Logical Or(w71, w86) -> w89
    Feedback Node(input=w90) -> w91
    call "802.11 MAC TX.gcdl"(TX after backoff request=w87, TX after SIFS request=w72, channel state indication=w64, global clock value=w45, RX TX turnaround time in global clock ticks=$"RX TX turnaround time", PSDU data ready for input=w91, PHY TX end indication=w38, MPDU block=w88, input valid=w89, reset MAC TX statistics=$"reset MAC TX statistics", Set Backoff Done Pulse to False=$"Set Backoff Done Pulse to False", TX Data After SIFS=w69) -> (MPDU=w92, output valid=w93, PHY TX start request=w94, TX after SIFS data ready for input=w67, TX after backoff data ready for input=w81, TX status indication=w83, MAC TX statistics=w95, TX after backoff done=w51, count out=w96)
    call "802.11 TX MAC Bypass.gcdl"(ready for output=w91, TX data FIFO reference="802.11 AFW Resources.grsc\\H2T TX Data", bypass MAC TX=$"bypass MAC TX", manual PhyTxStart.req=$"manual PhyTxStart.req", MPDU=w92, input valid=w93, request in=w94) -> (PSDU=w97, output valid=w98, request out=w99)
    call "802.11 PHY-SAP Write MAC.gcdl"(PHY-SAP=w33, PhyTxStart.req=w99, PSDU=w97, PSDU valid=w98, channel state indication=w55) -> (PSDU TX ready for input=w90)
    $"MAC RX statistics" <- w54
    call "Check ACK Received.gcdl"(ACK Received Pulse In=w59, TX after backoff done=w52, time to wait for decoding packet=$"time to wait for decoding packet", global clock counter=w45) -> (ACK Received out=w100, valid?=w101)
    FIFO Write(Control Protocol Input=w101, data=w100, reference in="802.11 AFW Resources.grsc\\ACK Received FIFO")
    call "niInstr Basic Elements v1 FPGA.lvlib__Count Up U32.gcdl"(increment=w60) -> (count out=w102)
    $"count piggyback" <- w102
    $"MAC TX statistics" <- w95
    $"data after sifs count" <- w96
    $"FPGA queue length" <- w74
    call "niInstr Basic Elements v1 FPGA.lvlib__Count Up U32.gcdl"(increment=w47) -> (count out=w103)
    # w37: PHY RX start indication
    # w39: PHY RX end indication
    # w34: CCA detection
    # w41: PHY RX Gain change indication
    $"enable piggyback register" <- w103
    # w40: PHY RX AGC state indication
    call "802.11 Write RX Events.gcdl"(global timestamp=w45, PHY RX start indication=w37, PHY RX end indication=w39, MAC channel state indication=w55, PHY CCA timing indication=w34, T2H FIFO reference="802.11 AFW Resources.grsc\\T2H Events", PHY RX Gain change indication=w41, PHY RX AGC state indication=w40)
    call "802.11 Capture PHY TX Indications.gcdl"(PHY TX end indication in=w38, PHY TX start request in=w99) -> (PHY TX start request out=w104, PHY TX end indication out=w105)
    $"PhyTxStart.req" <- w104
    $"authorized to contend?" <- w75
    $"PhyTxEnd.ind" <- w105
    call "802.11 Write TX Events.gcdl"(global time reference=w45, PHY TX end indication=w38, PHY TX start request=w99, TX status indication=w83, T2H FIFO reference="802.11 AFW Resources.grsc\\T2H Events")
    call "Backoff Block.gcdl"(Backoff: CW Max=$"Backoff: CW Max", Backoff: Exponential Backoff Ratio=$"Backoff: Exponential Backoff Ratio", Backoff: CW Min=$"Backoff: CW Min", Backoff: Fixed Backoff Value=$"Backoff: Fixed Backoff Value", Backoff: Fixed Backoff?=$"Backoff: Fixed Backoff?") -> (CW and Backoff Indicators=w106)
    $"CW and Backoff Indicators" <- w106
    Register Read(reference in="802.11 AFW Resources.grsc\\Has been transferred?") -> (data=w107)
    $"Has been transferred?" <- w107
    Register Read(reference in="802.11 AFW Resources.grsc\\Piggy") -> (data=w108)
    $Piggy <- w108
    Register Read(reference in="802.11 AFW Resources.grsc\\Head Mac Address") -> (data=w109)
    $"Head Mac Address" <- w109
    Register Read(reference in="802.11 AFW Resources.grsc\\ID Table") -> (data=w110)
    $"ID table" <- w110
    Register Write(data=$"Input: chain table", reference in="802.11 AFW Resources.grsc\\Chain Table")
    Register Write(data=$"Fixed backoff?", reference in="802.11 AFW Resources.grsc\\Fixed Backoff?")
    Register Write(data=$"CW Max", reference in="802.11 AFW Resources.grsc\\CW Max")
    Register Write(data=$"Exponential Backoff Ratio", reference in="802.11 AFW Resources.grsc\\Exponential Backoff Ratio")
    Register Read(reference in="802.11 AFW Resources.grsc\\Piggyback Address") -> (data=w111)
    $"PiggyBack Address" <- w111
    Register Write(data=$"CW Min", reference in="802.11 AFW Resources.grsc\\CW Min")
    Register Read(reference in="802.11 AFW Resources.grsc\\Chain Table") -> (data=w112)
    $"Chain Table" <- w112
    Register Write(data=$"Enable Piggyback", reference in="802.11 AFW Resources.grsc\\Enable Piggyback?")
    Register Write(data=$"Fixed backoff value", reference in="802.11 AFW Resources.grsc\\Fixed Backoff Value")
    Register Read(reference in="802.11 AFW Resources.grsc\\Check if it is matching?") -> (data=w113)
    $"Check if it is matching?" <- w113
    Register Read(reference in="802.11 AFW Resources.grsc\\Order ID in chain") -> (data=w114)
    $"Order in Chain" <- w114
    call "check if is the header.gcdl"(Order in the Chain=w114) -> (Is header?=w115)
    $"Is header?" <- w115
    Register Read(reference in="802.11 AFW Resources.grsc\\Check the ID") -> (data=w116)
    $"Check the ID" <- w116
    Register Read(reference in="802.11 AFW Resources.grsc\\Max ID") -> (data=w117)
    $"Index of Max ID" <- w117
  }
  FIFO Create(data type=CFXP(3.13) 0+0i, depth=17) -> (reference out=w118)
  FIFO Create(data type=CFXP(3.13) 0+0i, depth=1025) -> (reference out=w119)
  FIFO Create(data type=CFXP(3.13) 0+0i, depth=1025) -> (reference out=w120)
  FIFO Create(data type=UFXP(5.1) 0, depth=17) -> (reference out=w121)
  Property Node(instance in=T24 {all zero or empty}, "RF to RX FIFO"=w118, "internal loopback FIFO"=w119, "TX to RF FIFO"=w120, "Gain Settings FIFO"=w121) -> (instance out=w122)
  clock-driven loop (clock = "802.11 AFW Resources.grsc\\PHY") forever {
    Property Node(instance in=w21) -> ("global timestamp"=w123, "shared properties"=w124, "TX active"=w125, "OFDM symbol pulse"=w126)
    Register Read(reference in=w123) -> (data=w127)
    Property Node(instance in=w122) -> ("RF to RX FIFO"=w128, "internal loopback FIFO"=w129, "TX to RF FIFO"=w130, "Gain Settings FIFO"=w131)
    Register Read(reference in=w126) -> (data=w132, reference out=w133)
    Register Read(reference in=w124) -> (data=w134)
    # w132: Symbol trigger
    Property Node(instance in=w134) -> ("supported bandwidths"=w135, "DC centered signal"=w136, "channel selector"=w137)
    Feedback Node(input=w138) -> w139
    call "802.11 PHY-SAP Read PHY.gcdl"(PHY-SAP=w33, ready for output=w139) -> (PSDU=w140, PSDU valid=w141, PhyTxStart.req=w142)
    call "niInstr Basic Elements v1 FPGA.lvlib__Detect Rising Edge.gcdl"(signal=w132) -> (edge detected=w143)
    call "802.11 PHY TX Request Handler.gcdl"(symbol trigger in=w143, PhyTxStart.req=w142, supported bandwidths=w135) -> (symbol index=w144, symbol trigger out=w145, start of packet=w146, TX vector out=w147, PhyTxEnd.ind=w148, TX active=w149)
    Register Write(data=w149, reference in=w125) -> (reference out=w150)
    call "802.11 RX Data Source.gcdl"(RX data source=$"RX data source", mute RX while TX active?=$"mute RX while TX active?", TX active register=w150, RF to RX FIFO=w128, internal loopback FIFO=w129, OFDM symbol trigger register=w133, produce silent samples=$"produce silent samples", H2T FIFO="802.11 AFW Resources.grsc\\H2T RX Baseband") -> (sample=w151, output valid=w152)
    call "802.11 Signal Filter.gcdl"(sample in=w151, input valid=w152, configuration=w134) -> (20MHz sample out=w153, output valid=w154, 40MHz sample out=w155, 80MHz sample out=w156)
    Feedback Node(input=w157) -> w158
    call "802.11 Synchronization.gcdl"(bypass synchronization=$"bypass synchronization", rearm packet start generator=$"rearm packet start generator", packet start sample index=$"packet start sample index", synchronization settings=$"synchronization settings", rearm sychronization=w158, sample in=w151, input valid=w152, filtered sample=w153, filtered sample valid=w154) -> (sample out=w159, output valid=w160, packet start=w161, compensated CFO=w162, CCA signal detected=w163)
    w164 = T19 {"format"="a", "channel selector"=0, "device MAC address"=[0, 0, 0, 0, 0, 0], "DC centered signal"=FALSE, "supported bandwidths"={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}}
    Feedback Node(enable?=w161, initial value=w164, input=w134) -> w165
    Property Node(instance in=w165) -> ("format"=w166, instance out=w167)
    Feedback Node(input=w168) -> w169
    call "802.11 RX IQ Processing.gcdl"(sample=w159, input valid=w160, packet start=w161, configuration=w169) -> (subcarrier=w170, subcarrier timing=w171, subcarrier field map=w172, last sample received=w173, channel estimate=w174, channel estimate timing=w175)
    Feedback Node(input=w176) -> w177
    call "802.11 RX Bit Processing.gcdl"(subcarrier timing=w171, subcarrier=w170, field map=w172, configuration=w177, noise coefficient=$"noise coefficient") -> (current OFDM symbol=w178, PSDU=w179, bit=w180, bit valid=w181, last byte decoded=w182, PSDU valid=w183)
    call "802.11 RX PHY State Machine.gcdl"(bit=w180, bit valid=w181, shared properties=w167, current OFDM symbol=w178, last bit of packet decoded=w182, last sample of packet received=w173, global timestamp=w127) -> (RX bit processing configuration=w176, RX IQ processing configuration=w168, PhyRxStart.ind=w184, PhyRxEnd.ind=w185)
    Property Node(instance in=w185) -> ("valid"=w157)
    Feedback Node(input=w186) -> w187
    To Fixed Point(number=w187) -> w188: FXP(10.3) Saturate:ConvergentRounding
    Select(s=$"enable AGC", t=w188, f=$"RF gain") -> w189
    call "802.11 Power Measurement.gcdl"(sample=w156, input valid=w154, CCA energy detect threshold=$"CCA energy detect threshold", power calibration offset=$"power calibration offset", RF gain=w189, sample 20MHz filtered=w153, sample 40MHz filtered=w155) -> (signal power=w190, output valid=w191, out of range?=w192, CCA energy detect=w193, RF input power=w194)
    Property Node(instance in=T21 {all zero or empty}, "CCA energy detection busy"=w193, "CCA signal detection busy"=w163) -> (instance out=w195)
    call "802.11 AGC.gcdl"(signal power=w190, packet start=w161, rearm AGC=w158, AGC thresholds=$"AGC tresholds", AGC timeout=$"AGC timeout", signal power valid=w191, enable AGC=$"enable AGC") -> (gain=w196, trigger gain setting=w197, state=w198, last applied gain=w186)
    Property Node(instance in=T23 {all zero or empty}, "trigger gain setting"=w197, "gain"=w196) -> (instance out=w199)
    w200 = cluster{"AGC state": T22, "AGC enabled": bool} {all zero or empty}
    Property Node(instance in=w200, "AGC state"=w198, "AGC enabled"=$"enable AGC") -> (instance out=w201)
    call "802.11 PHY-SAP Write PHY.gcdl"(PHY-SAP=w33, PSDU valid=w183, PSDU=w179, CCA detection=w195, PhyRxEnd.ind=w185, PhyRxStart.ind=w184, PhyTxEnd.ind=w148, PHY RX Gain change indication=w199, PHY RX AGC state indication=w201)
    call "802.11 Prepare RX IQ Data for T2H.gcdl"(subcarrier=w170, timing=w171, field map=w172, FIFO reference="802.11 AFW Resources.grsc\\T2H Constellation") -> (FIFO overflow count=w202)
    $"T2H Constallation overflow" <- w202
    call "802.11 Prepare Channel Estimation for T2H.gcdl"(channel estimate=w174, timing=w175, format=w166, FIFO reference="802.11 AFW Resources.grsc\\T2H Channel Estimation") -> (FIFO overflow count=w203)
    $"T2H Channel Estimation overflow" <- w203
    call "802.11 Trigger Capture RX Samples.gcdl"(trigger condition=$"trigger condition", manual trigger=$"manual trigger", RX packet start=w161, TX active register=w150, CCA energy detected=w193) -> (trigger=w204)
    call "802.11 Capture RX Samples.gcdl"(sample=w159, input valid=w160, trigger=w204, number of samples to capture=$"number of samples to capture", FIFO reference="802.11 AFW Resources.grsc\\T2H RX Power Spectrum", number of samples before trigger=$"number of samples before trigger") -> (FIFO overflow count=w205)
    $"T2H RX Power Spectrum overflow" <- w205
    call "802.11 TX Bit Processing.gcdl"(symbol trigger=w145, OFDM symbol index=w144, TX vector=w147, PSDU=w140, input valid=w141) -> (bit=w206, output valid=w207, ready for input=w138, modulation=w208)
    call "802.11 TX IQ Processing.gcdl"(symbol trigger=w145, OFDM symbol index=w144, TX vector=w147, channel selector=w137, start of packet=w146, bit valid=w207, bit=w206, bit processing modulation=w208, DC centered signal=w136, supported bandwidths=w135) -> (data out=w209, output valid=w210)
    call "802.11 TX Data Sink.gcdl"(TX to RF FIFO=w130, internal loopback FIFO=w129, sample=w209, input valid=w210, T2H FIFO="802.11 AFW Resources.grsc\\T2H TX Baseband") -> (T2H FIFO overflow count=w211, TX to RF FIFO overflow count=w212, internal loopback FIFO overflow count=w213)
    $"T2H TX Baseband FIFO overflow" <- w211
    $"TX to RF FIFO overflow" <- w212
    $"compensated CFO" <- w162
    $"internal loopback FIFO overflow" <- w213
    call "802.11 RX Bit Processing Data Sink.gcdl"(PSDU=w179, input valid=w183, FIFO reference="802.11 AFW Resources.grsc\\T2H RX Bit Processing Output") -> (FIFO overflow count=w214)
    $"T2H RX Bit Processing Output FIFO overflow" <- w214
    call "802.11 TX Bit Processing Data Sink.gcdl"(bit=w206, input valid=w207, modulation=w208, FIFO reference="802.11 AFW Resources.grsc\\T2H TX Bit Processing Output") -> (FIFO overflow count=w215)
    $"T2H TX Bit Processing Output FIFO overflow" <- w215
    call "802.11 Capture PHY RX Indications.gcdl"(PHY RX start indication in=w184, PHY RX end indication in=w185) -> (PHY RX start indication out=w216, PHY RX end indication out=w217)
    $"PhyRxStart.ind" <- w216
    $"PhyRxEnd.ind" <- w217
    $"RF input power" <- w194
    Feedback Node(enable?=w161, input=w194) -> w218
    $"RF input power at packet start" <- w218
    $"signal power" <- w190
    Feedback Node(enable?=w161, input=w190) -> w219
    $"signal power at packet start" <- w219
    $"out of range?" <- w192
    FIFO Write(Control Protocol Input=w197, data=w196, reference in=w131)
    $"last applied gain" <- w186
  }
  call "Create Resources.gvi"() -> (config.resources=w220, sync.resources=w221, time.resources=w222)
  clock-driven loop (clock = "40 MHz Onboard Clock") {
    Io Write(data=$"RF 1/Rx/Enable", reference in="RF 1/Rx/Enable")
    Io Write(data=$"RF 0/Tx/Enable", reference in="RF 0/Tx/Enable")
    Io Write(data=$"RF 0/Rx/Enable", reference in="RF 0/Rx/Enable")
    Feedback Node(input=w223) -> w224
    Property Node(instance in=w122) -> ("Gain Settings FIFO"=w225)
    FIFO Read(Control Protocol Input=TRUE, reference in=w225) -> (Control Protocol Output=w223, data=w226)
    Feedback Node(enable?=w223, input=w226) -> w227
    To Fixed Point(number=w227) -> w228: UFXP(6.1) Wrap:Truncate
    # Register Bus and Required Controls/Indicators
    Scale By Power Of 2(n=1, x=w228) -> w229
    To Unsigned Byte Integer(number=w229) -> w230
    Property Node(instance in=T2 {"power enable"=TRUE, "mixer enable"=TRUE, "gain"=0}, "power enable"=$"power enable", "mixer enable"=$"mixer enable", "gain"=w230) -> (instance out=w231)
    call "Set Gain.gcdl"(ATR State=$"ATR State", Radio Control Destination=$"Radio Control Destination", FPGA.Fifo="802.11 AFW Resources.grsc\\AGC Reg Bus 0 Access FIFO", daughterboard=$daughterboard, antenna configuration=$"antenna configuration", Write ATR?=w224, lo lpf enable=$"lo lpf enable", rx.configuration=w231, tx.configuration=$"tx.configuration", spi address=$"spi address", cpld enable=$"cpld enable")
    Io Write(data=$"RF 1/Tx/Enable", reference in="RF 1/Tx/Enable")
    Feedback Node(input=w232) -> w233
    Property Node(instance in=w233) -> ("ready for port 0 input"=w234, "ready for port 1 input"=w235)
    Feedback Node(input=w236) -> w237
    call "niInstr Register Bus v1 FPGA.lvlib__Process.gcdl"(reg.notify host.go rcvd=$"reg.notify host.go rcvd 0", reg.host read.go rcvd=$"reg.host read.go rcvd 0", read completion=w237, reg.reset=$"reg.reset 0", reg.host instruction fifo="niInstr Register Bus v0.grsc\\reg.host instruction fifo 0", ready for output=w235) -> (reg.notify host.go=w238, reg.host read.data=w239, register instruction=w240)
    $"reg.notify host.go 0" <- w238
    $"reg.host read.data 0" <- w239
    FIFO Read(Control Protocol Input=w234, reference in="802.11 AFW Resources.grsc\\AGC Reg Bus 0 Access FIFO") -> (Control Protocol Output=w241, data=w242)
    call "Retrieve FPGA Scoped Instruction.gcdl"(number=w242, valid=w241) -> (output cluster=w243)
    Feedback Node(input=w244) -> w245
    call "niInstr Register Bus v1 FPGA.lvlib__Register Instruction Arbiter (2 inputs).gcdl"(port 0=w243, port 1=w240, reset=FALSE, ready for output=w245) -> (register instr out=w246, ready for input=w232)
    call "Registers.gcdl"(register instruction=w246, config.resources=w220, sync.resources=w221, time.resources=w222) -> (read completion out=w236, ready for input=w244)
    stop if FALSE
  }
  clock-driven loop (clock = "Data Clock") forever {
    # Baseband to/from RF conversion
    # Data Reception from Antenna, downconversion to baseband sample rate, received data will be written into RX baseband input FIFO
    # Reading of TX baseband FIFO, upconversion and transmission to antenna
    Property Node(instance in=w21) -> ("shared properties"=w247, "global timestamp"=w248, "OFDM symbol pulse"=w249)
    call "Mod N Indexer U16 v2.gcdl"(N=$"Data clock cycles per tick (0.1us)", enable=$"data clock locked?") -> (wrap back?=w250)
    call "niInstr Basic Elements v1 FPGA.lvlib__Count Up U32.gcdl"(increment=w250, reset=FALSE) -> (count out=w251)
    Register Write(data=w251, reference in=w248)
    call "Mod N Indexer U16 v2.gcdl"(N=$"Data clock cycles per OFDM symbol", enable=$"data clock locked?") -> (wrap back?=w252)
    Register Write(data=w252, reference in=w249)
    w253 = T18 {"5 MHz"=FALSE, "10 MHz"=FALSE, "20 MHz"=TRUE, "40 MHz"=TRUE, "80 Mhz"=FALSE, "160 MHz"=FALSE}
    w254 = T19 {"format"="a", "channel selector"=0, "device MAC address"=[0, 0, 0, 0, 0, 0], "DC centered signal"=FALSE, "supported bandwidths"={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}}
    Property Node(instance in=w254, "format"=$format, "channel selector"=$"channel selector", "device MAC address"=$"device MAC address", "DC centered signal"=$"DC centered signal", "supported bandwidths"=w253) -> (instance out=w255)
    Register Write(data=w255, reference in=w247)
    $Timestamp <- w251
    Property Node(instance in=w122) -> ("TX to RF FIFO"=w256, "RF to RX FIFO"=w257)
    Build Array($"rx 0.stream enable", $"rx 1.stream enable") -> w258
    w259 = T25 {"0x800000000000", 0, 0, "0x1FFFF", "0x1FFFF", 0, 0, 0, 0, 0, 0, 0}
    Property Node(instance in=w259, "impairments"=$"rx 0.impairments", "frequency shift"=$"rx 0.frequency shift", "phase"=$"rx 0.phase", "output sample rate"=$"rx.output sample rate", "delay"=$"rx.delay") -> (instance out=w260)
    w261 = T25 {"0x800000000000", 0, 0, "0x1FFFF", "0x1FFFF", 0, 0, 0, 0, 0, 0, 0}
    Property Node(instance in=w261, "delay"=$"rx.delay", "output sample rate"=$"rx.output sample rate", "impairments"=$"rx 1.impairments", "frequency shift"=$"rx 1.frequency shift", "phase"=$"rx 1.phase") -> (instance out=w262)
    Build Array(w260, w262) -> w263
    call "802.11 USRP Stream RX.gcdl"(RF to RX FIFO reference=w257, enable DC offset correction=$"enable DC offset correction", rx.reset=$"rx.reset", rx.rf channel=$"rx.rf channel", rx. stream enabled=w258, rx.abort=$"rx.abort", DDC parameters=w263) -> (rx.number of IQ data overflows=w264, rx.dsp reset done=w265, DC average=w266, rx.state=w267, rx.samples processed=w268, rx.number of overflows=w269)
    $"rx.number of IQ data overflows" <- w264
    Build Array($"tx 0.stream enable", $"tx 1.stream enable") -> w270
    w271 = T26 {0, "0x1FFFF", "0x1FFFF", 0, 0, 0, 0, 0, 0, 0, 0, "0x200000", "0x200000", 0}
    Property Node(instance in=w271, "gain"=$"tx 0.gain", "frequency shift"=$"tx 0.frequency shift", "phase"=$"tx 0.phase", "impairments"=$"tx 0.impairments", "input sample rate"=$"tx.input sample rate", "delay"=$"tx.delay") -> (instance out=w272)
    w273 = T26 {0, "0x1FFFF", "0x1FFFF", 0, 0, 0, 0, 0, 0, 0, 0, "0x200000", "0x200000", 0}
    Property Node(instance in=w273, "delay"=$"tx.delay", "input sample rate"=$"tx.input sample rate", "gain"=$"tx 1.gain", "frequency shift"=$"tx 1.frequency shift", "phase"=$"tx 1.phase", "impairments"=$"tx 1.impairments") -> (instance out=w274)
    Build Array(w272, w274) -> w275
    call "802.11 USRP Stream TX.gcdl"(tx.enable streams=w270, tx.reset=$"tx.reset", tx.rf channel=$"tx.rf channel", TX to RF FIFO reference=w256, tx.abort=$"tx.abort", DUC parameters=w275) -> (tx.state=w276, tx.samples processed=w277, tx.underflows=w278, tx.number of IQ data overflows=w279, tx.dsp reset done=w280)
    $"tx.state" <- w276
    $"rx.dsp reset done" <- w265
    $"tx.samples processed" <- w277
    $"rx.state" <- w267
    $"tx.underflows" <- w278
    $"rx.samples processed" <- w268
    $"tx.number of IQ data overflows" <- w279
    $"rx.number of overflows" <- w269
    $"tx.dsp reset done" <- w280
    $"DC average" <- w266
  }
  call "LEDs.gvi"()
  call "niUsrpRio Config v1 FPGA.lvlib__Process.gvi"(resources=w220)
